# Dynamo graph Quad Grid Ellipse Tower.dyn (Dynamo 2.1.0.7500)

# group: Input
no_levels = IntegerSlider(16, range=2..20 step 1)
level_height = IntegerSlider(3400, range=2500..5000 step 100)
building_radius_xaxis = IntegerSlider(8100, range=3000..15000 step 300)
top_size_of_bottom = DoubleSlider(68, range=50..100 step 1)
building_radius_yaxis = IntegerSlider(12000, range=3000..15000 step 300)
rotation_per_level = IntegerSlider(7, range=0..30 step 1)
no_segments_around_radius = IntegerSlider(32, range=6..100 step 1)
family_types = FamilyTypes("Quad-Tri:Quad-Tri")

code_block = CodeBlock(n=no_levels, h=level_height) { 0..(n*h)..#(n+1); }
byCoordinates = Point.ByCoordinates(z=code_block)
ZAxis = Vector.ZAxis()
byOriginNormal = Plane.ByOriginNormal(origin=byCoordinates, normal=ZAxis)
byPlane = CoordinateSystem.ByPlane(plane=byOriginNormal)
code_block_2 = CodeBlock(x=building_radius_xaxis, p=top_size_of_bottom, n=no_levels) { x..(x*p/100)..#(n+1); }
code_block_3 = CodeBlock(y=building_radius_yaxis, p=top_size_of_bottom, n=no_levels) { y..(y*p/100)..#(n+1); }
byCoordinateSystemRadii = Ellipse.ByCoordinateSystemRadii(origin=byPlane, xAxisRadius=code_block_2, yAxisRadius=code_block_3)
code_block_4 = CodeBlock(R=rotation_per_level, n=no_levels) { 0..R*n..#(n+1); }
rotate = Geometry.Rotate(geometry=byCoordinateSystemRadii, basePlane=byOriginNormal, degrees=code_block_4)
code_block_5 = CodeBlock(n=no_segments_around_radius) { 0..1..#n; }
pointAtParameter = Curve.PointAtParameter(curve=rotate, param=code_block_5, lacing=CrossProduct)
python_script = Python(IN[0]=pointAtParameter)
# ---------- python_script.python (29 lines) ----------
# Load the Python Standard and DesignScript Libraries
import sys
import clr
clr.AddReference('ProtoGeometry')
from Autodesk.DesignScript.Geometry import *

# The inputs to this node will be stored as a list in the IN variables.
listOfPointLists = IN[0]

listsOfPairs = []
for ListOfPoints in listOfPointLists:
    onePair = []
    for pointIndex in range(len(ListOfPoints)):
        onePair.append([ListOfPoints[pointIndex - 1], ListOfPoints[pointIndex]])
    listsOfPairs.append(onePair)


listOfQuads = []
for IndexOfPairList in range(len(listsOfPairs)):
    for pairListIndex in range(len(listsOfPairs[IndexOfPairList])):
        oneQuad = []
        for point in listsOfPairs[IndexOfPairList][pairListIndex]:
            oneQuad.append(point)
        for point in reversed(listsOfPairs[IndexOfPairList - 1][pairListIndex]):
            oneQuad.append(point)
        listOfQuads.append(oneQuad)

OUT=listOfQuads
# Assign your output to the OUT variable.
# ----------------------------------------
code_block_6 = CodeBlock(n=no_segments_around_radius) { n; }
dropItems = List.DropItems(list=python_script, amount=code_block_6)
byPoints = AdaptiveComponent.ByPoints(points=dropItems, familyType=family_types)
code_block_7 = CodeBlock(n=no_levels) { 0..n..#n+1; }
code_block_8 = CodeBlock(a=building_radius_xaxis, b=building_radius_yaxis, n=no_levels) { a..b..#(n+1); }
boolean = BoolSelector(false)
byPoints_2 = PolyCurve.ByPoints(points=pointAtParameter, connectLastToFirst=boolean)
closeWithLine = PolyCurve.CloseWithLine(polyCurve=byPoints_2)
code_block_9 = CodeBlock { -100; }
offset = Curve.Offset(curve=closeWithLine, distance=code_block_9)
code_block_10 = CodeBlock { 2; }
flatten = List.Flatten(list=offset, amt=code_block_10)
floor_types = FloorTypes("Insitu Concrete 225mm")
code_block_11 = CodeBlock(n=no_levels, h=level_height) { 0..n*h..#(n+1); }
byElevation = Level.ByElevation(elevation=code_block_11)
byOutlineTypeAndLevel = Floor.ByOutlineTypeAndLevel(outlineCurves=flatten, floorType=floor_types, level=byElevation, lacing=CrossProduct)
